# Grasshopper definition Utilities_Collection of working c# codes.gh (Grasshopper 1.0.7)

# ----
# Exporting frames to a folder(used with kangaroo2 step solver)
file_path = FilePath("C:\Users\User\Desktop\Thesis Drive\Graphics\2_Animation\200430\TestTimerCapture\")
panel = Panel(file_path)
timer = Timer(TimerInterval=6000, Target=c_script)  # disabled
c_script = CSharpScript(iReset=Button(), iStart=Toggle(False), Path=panel, Name="image", iFrames=Slider(1700, range=0..1700))  # -> out; inputs iReset: Boolean, iStart: Boolean, Path: String, Name: String, iFrames: Int32
# ---------- c_script: C# usings ----------
using Rhino.Display;
using System.Threading;
# ---------- c_script: C# ----------
    
    if(iReset) counter = 0;
    
    if(iStart) {
      var view = doc.Views.ActiveView;
      var view_capture = new ViewCapture
        {
          Width = view.ActiveViewport.Size.Width,
          Height = view.ActiveViewport.Size.Height,
          ScaleScreenItems = false,
          DrawAxes = false,
          DrawGrid = false,
          DrawGridAxes = false,
          TransparentBackground = true
          };

      if(counter < iFrames){
        var screenshot = view_capture.CaptureToBitmap(view);
        if(screenshot != null)
        {
          string filename = Path + Name + counter + ".png";
          screenshot.Save(filename, System.Drawing.Imaging.ImageFormat.Png);
          Print("Count: " + counter);
          counter += 1;
        }
      }
    }
# ---------- c_script: C# additional code ----------
  int counter = 0;
# ---------- end c_script ----------
panel_2 = Panel(c_script)

# ----
# A LIST OF C# CODE THAT WORKS
# filter data type of a list
c_script_2 = CSharpScript()  # -> out, A; inputs x: list
# ---------- c_script_2: C# usings ----------
using System.Linq;
# ---------- c_script_2: C# ----------
    //List <double> output = new List<double>{};

    A = getRadius(x);

    //A = output;
# ---------- c_script_2: C# additional code ----------
  public List<double> getRadius(List<object> item)
  {
    return item.OfType<double>().ToList();
  }
# ---------- end c_script_2 ----------

# ----
# Tree branch/data management static function
c_script_3 = CSharpScript()  # -> out, A
# ---------- c_script_3: C# ----------
    //ListOfListsToTree("name of listof list");
# ---------- c_script_3: C# additional code ----------
  static Grasshopper.DataTree<T> ListOfListsToTree<T > (List < List < T >> s){
  Grasshopper.DataTree<T> tree = new DataTree<T>();
  for(int i = 0;i < s.Count; i++){
  tree.AddRange(s[i], new GH_Path(i));
}
      return tree;
    }
# ---------- end c_script_3 ----------

# ----
# Loop/iterate through Data Tree
c_script_4 = CSharpScript()  # -> out, A; inputs x: tree
# ---------- c_script_4: C# ----------
    for(int i = 0; i < x.BranchCount; i++){
      for(int j = 0; j < x.Branch(i).Count; j++){
        
      }
    }
# ---------- end c_script_4 ----------
